# Grasshopper definition bem_model_serialize.gh (Grasshopper 1.0.7)

# ----
# Step 1:
# Set file path to Models dir
# ..\data\models\
path = FilePath("C:\Users\saeran2\master\git\deeprad\data\models\")

number_slider = Slider(10, range=0..10)
python = GhPythonScript(model_num=Slider(4999, range=0..4999), models_dir=path, run=Toggle(True))  # -> polys, model_id, ghout_id_dir, sim_dir; inputs model_num: Int32
# ---------- python: Python ----------
import os 
import json 
#import rhinoscriptsyntax as rs
import Rhino as rc

# Path to all models in deep_rad
DEEPRAD_MODELS_DIR = _models_dir
DEEPRAD_GHOUT_DIR = os.path.join(
        DEEPRAD_MODELS_DIR, '..', 'ghout')
  
def extract_floorplan_ids(data_num):
    """Safely extract root model directories for polygon extraction."""

    # Load all model directories
    floorplan_id_arr = os.listdir(DEEPRAD_MODDELS_DIR)
    n_ids = len(floorplan_id_arr)
    
    if data_num > n_ids:
        print('Note: data_num {} is too high. Resetting to n_ids {}.'.format(
            data_num, n_ids))
        data_num = n_ids
    
    return data_num, floorplan_id_arr

def to_poly_rh(poly_xy):
    pts = [(round(x, 5), round(y, 5), 0) for x,y in zip(*poly_xy)]
    pts = [rc.Geometry.Point3d(*pt) for pt in pts]
    pts = pts + [pts[0]]
    return rc.Geometry.Polyline(pts)

def load_json(json_fpath):
    with open(json_fpath, 'r') as fp:
        val_dict = json.load(fp)
    return val_dict

#def get_model(_model_num):
#    _model_num = int(_model_num)
#    _model_num, model_ids = extract_floorplan_ids(_model_num)
#    model_id = model_ids[_model_num]
#    return model_id 
    
if run:
    
    #null_fpath = os.path.join(DEEPRAD_MODELS_DIR, '_null.txt')
    #with open(null_fpath, 'r') as fp:
    #    null_lst = fp.readlines()
    #null_lst = sorted(null_lst)
    #model_id_lst = [n.replace('\n', '') for n in null_lst]
    
    model_id_lst = sorted(os.listdir(DEEPRAD_MODELS_DIR))[1:]
    model_id_lst.sort(key=lambda ss: int(ss.split('_')[-1]))
    model_id = model_id_lst[_model_num]
    
    # Polygon json
    model_id_dir = os.path.join(
        DEEPRAD_MODELS_DIR, model_id)
    polygon_json_fpath = os.path.join(model_id_dir, 'data', 'polygon.json')

    polygons = load_json(polygon_json_fpath)
    polygons = polygons['polygons']
    
    polys = [to_poly_rh(polygon) for polygon in polygons]
    sim_dir = os.path.join(DEEPRAD_MODELS_DIR, '..', 'hbjsons', '{}_hb'.format(_model_num))
    sim_dir = os.path.abspath(sim_dir)
    
    ghout_id_dir = os.path.join(DEEPRAD_GHOUT_DIR, model_id)
    ghout_id_dir = os.path.abspath(ghout_id_dir)
# ---------- end python ----------
panel = Panel(python.sim_dir)
data = Data(python.polys)

# ----
# Center geoms
boundary = BoundarySurfaces(Edges=data)
bbox = BoundingBox(Content=boundary, Plane=PlaneXY(0, 0, 0), UnionBox=True)  # -> Box, Box_2
area = Area(Geometry=bbox.Box)  # -> Area, Centroid

# ----
# Multiply by 3 floors
panel_2 = Panel("""0
2.5""")
neg = Negative(Value=area.Centroid)
Z = UnitZ(Factor=panel_2)
move = Move(Geometry=data, Motion=neg)  # -> Geometry, Transform
dup = DuplicateData(Data=graft(move.Geometry), Number="2", Order=True)  # -> simplify(Data)
flip = FlipMatrix(Data=dup)
move_2 = Move(Geometry=flip, Motion=graft(Z))  # -> Geometry, Transform
bang = ExplodeTree(Data=simplify(move_2.Geometry))  # -> Branch0, Branch1

boundary_2 = BoundarySurfaces(Edges=graft(bang.Branch0))  # -> flatten(Surfaces)
boundary_3 = BoundarySurfaces(Edges=graft(bang.Branch1))  # -> flatten(Surfaces)
room2d = DFRoom2D(geo=flatten(boundary_2), flr_to_ceiling="2.5", conditioned=Toggle(True))  # -> report, room2d; plug-in component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
room2d_2 = DFRoom2D(geo=flatten(boundary_3), flr_to_ceiling="2.5", conditioned=Toggle(True))  # -> report, room2d; plug-in component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
toggle = BooleanToggle(True)
toggle_2 = BooleanToggle(True)
simpleratiopar = DFSimpleWindowRatioParameters(ratio="0.3")  # -> win_par; plug-in component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
simpleratiopar_2 = DFSimpleWindowRatioParameters(ratio="0.3")  # -> win_par; plug-in component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
panel_3 = Panel("https://www.energyplus.net/weather-download/north_and_central_america_wmo_region_4/USA/MA/USA_MA_Boston-Logan.Intl.AP.725090_TMY3/all")
introom2d = DFIntersectRoom2Ds(room2ds=flatten(room2d.room2d), run=toggle)  # -> int_room2ds; plug-in component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
solveadj2d = DFSolveAdjacency(room2ds=flatten(introom2d), run=toggle)  # -> report, adj_room2ds; plug-in component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
introom2d_2 = DFIntersectRoom2Ds(room2ds=flatten(room2d_2.room2d), run=toggle_2)  # -> int_room2ds; plug-in component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
solveadj2d_2 = DFSolveAdjacency(room2ds=flatten(introom2d_2), run=toggle_2)  # -> report, adj_room2ds; plug-in component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
applyfacadepar = DFApplyFacadeParameters(df_obj=flatten(solveadj2d.adj_room2ds), win_par=simpleratiopar)  # -> report, df_obj; plug-in component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
applyfacadepar_2 = DFApplyFacadeParameters(df_obj=flatten(solveadj2d_2.adj_room2ds), win_par=simpleratiopar_2)  # -> report, df_obj; plug-in component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
panel_4 = Panel(python.model_id)
panel_5 = Panel(python.sim_dir)
downloadepw = LBDownloadWeather(weather_URL=panel_3)  # -> epw_file, stat_file, ddy_file; plug-in component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
story = DFStory(room2ds=flatten(applyfacadepar.df_obj))  # -> report, story; plug-in component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
story_2 = DFStory(room2ds=flatten(applyfacadepar_2.df_obj))  # -> report, story; plug-in component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
toggle_3 = BooleanToggle(True)
simoutput = HBSimulationOutput(zone_energy_use=toggle_3, gains_and_losses=toggle_3, surface_energy_flow=toggle_3, report_frequency="Daily")  # -> report, sim_output; plug-in component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
buildingstories = DFBuildingFromStories(stories=[story.story, story_2.story])  # -> report, building; plug-in component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
model = DFModel(buildings=flatten(buildingstories.building), name=panel_4)  # -> report, model; plug-in component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
customoutput = HBCustomSimulationOutput(base_sim_output=simoutput.sim_output)  # -> report, sim_output; plug-in component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
analysisperiod = LBAnalysisPeriod(start_month="1", start_day=1, start_hour=0, end_month="1")  # -> period, hoys, dates; plug-in component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
tohoneybee = DFModelToHoneybee(model=model.model, run=Toggle(True))  # -> report, hb_models; plug-in component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
simpar = HBSimulationParameter(output=customoutput.sim_output, run_period=analysisperiod.period, timestep="2")  # -> sim_par; plug-in component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
toggle_4 = BooleanToggle(True)
vizbytype = HBVisualizeByType(hb_objs=tohoneybee.hb_models)  # -> walls, interior_walls, roofs, ceilings, exterior_floors, interior_floors, air_walls, apertures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; disabled; plug-in component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
vizbybc = HBVizualizeByBC(hb_objs=tohoneybee.hb_models)  # -> outdoors, surface, ground, adiabatic, other, wire_frame; disabled; plug-in component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
vizall = HBVizualizeAll(hb_objs=flatten(tohoneybee.hb_models))  # -> geo; disabled; plug-in component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
modeltoosm = HBModelToOSM(model=tohoneybee.hb_models, epw_file=downloadepw.epw_file, sim_par=simpar, folder=panel_5, write=toggle_4, run=toggle_4)  # -> report, jsons, osw, osm, idf, sql, zsz, rdd, html; plug-in component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
mjoin = MeshJoin(Meshes=[vizbytype.walls, vizbytype.apertures])  # disabled
facen = FaceNormals(Mesh=vizbytype.apertures)  # -> Centers, Normals; disabled
panel_6 = Panel("0.006")  # disabled
facen_2 = FaceNormals(Mesh=mjoin)  # -> Centers, Normals; disabled
panel_7 = Panel(modeltoosm.sql)
multiplication = Multiplication(A=facen.Normals, B=panel_6)  # disabled
data_2 = Data()  # disabled
move_3 = Move(Geometry=vizbytype.apertures, Motion=multiplication)  # -> Geometry, Transform; disabled
swatch = ColourSwatch(SwatchColor=RGB(0, 0, 0))  # disabled
python_2 = GhPythonScript(depth_vec=facen_2.Centers, orient=data_2)  # -> depth_val; inputs depth_vec: list; disabled
# ---------- python_2: Python ----------
import rhinoscriptsyntax as rs

depth_vec = [rs.coerce3dpoint(xx) for xx in depth_vec]

if orient == 'north' or orient == 'south': 
    depth_axis = 1  # y-axis
else:
    depth_axis = 0  # x-axis

depth_val = [xx[depth_axis] for xx in depth_vec]
# ---------- end python_2 ----------
medges = MeshEdges(Mesh=move_3.Geometry)  # -> NakedEdges, InteriorEdges, NonManifoldEdges; disabled
preview = CustomPreview(Geometry=[vizbytype.wire_frame, medges.NakedEdges, medges.InteriorEdges, medges.NonManifoldEdges], Material=swatch)  # disabled
