# Grasshopper definition bem_simulate_2.gh (Grasshopper 1.0.7)
# plug-ins: Heteroptera, Ironbug.LBHB_Legacy, Bifocals

path = FilePath("C:\Users\Administrator\master\git\deeprad\data\models\")
toggle = BooleanToggle(True)  # disabled
panel = Panel("1.1.0")  # disabled
versioner = LBVersioner(update=toggle, version=panel)  # -> Vviiiiiz; disabled; plug-in component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
panel_2 = Panel(versioner)  # disabled
model_deg = Slider(39, range=0..39)
panel_3 = Panel("4000")
panel_4 = Panel("https://www.energyplus.net/weather-download/north_and_central_america_wmo_region_4/USA/MA/USA_MA_Boston-Logan.Intl.AP.725090_TMY3/all")
python = GhPythonScript(idx=model_deg, sleep=Toggle(True), data_num="10")  # -> model_num, degree, slider_num; inputs sleep_milli: Int32, data_num: Int32
# ---------- python: Python ----------
import rhinoscriptsyntax as rs

DEG_NUM = 4

idx = int(_idx + 1)

degree = idx % DEG_NUM
model_num = int(_idx / DEG_NUM)

print(model_num, degree)

slider_num = str(_data_num_ * DEG_NUM) + ' - 1'

if _sleep_milli_ is None:
    _sleep_milli_ = 1500 
if _sleep_:
    rs.Sleep(_sleep_milli_)
# ---------- end python ----------
panel_5 = Panel(python.model_num)
panel_6 = Panel(python.degree)
toggle_2 = BooleanToggle(True)
simpleratiopar = DFSimpleWindowRatioParameters(ratio="0.3")  # -> win_par; plug-in component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
python_2 = GhPythonScript(deg=panel_6)  # -> orient, point
# ---------- python_2: Python ----------
import math 
import Rhino.Geometry as rhgeom

D = {0: 'north', 90: 'east', 180: 'south', 270: 'west'} 

a = deg * 90.0
rad = a / 180.0 * math.pi

point = rhgeom.Point3d(math.sin(rad) * 100, math.cos(rad) * 100, 0)
orient = D[int(a)]
# ---------- end python_2 ----------
python_3 = GhPythonScript(model_num=panel_5, models_dir=path, run=Toggle(True))  # -> polys, model_id, ghout_id_dir, sim_dir; inputs model_num: Int32
# ---------- python_3: Python ----------
import os 
import json 
#import rhinoscriptsyntax as rs
import Rhino as rc

# Path to all models in deep_rad
DEEPRAD_MODELS_DIR = _models_dir
DEEPRAD_GHOUT_DIR = os.path.join(
        DEEPRAD_MODELS_DIR, '..', 'ghout')
    

def extract_floorplan_ids(data_num):
    """Safely extract root model directories for polygon extraction."""

    # Load all model directories
    floorplan_id_arr = os.listdir(DEEPRAD_MODDELS_DIR)
    n_ids = len(floorplan_id_arr)
    
    if data_num > n_ids:
        print('Note: data_num {} is too high. Resetting to n_ids {}.'.format(
            data_num, n_ids))
        data_num = n_ids
    
    return data_num, floorplan_id_arr

def to_poly_rh(poly_xy):
    pts = [(round(x, 5), round(y, 5), 0) for x,y in zip(*poly_xy)]
    pts = [rc.Geometry.Point3d(*pt) for pt in pts]
    pts = pts + [pts[0]]
    return rc.Geometry.Polyline(pts)

def load_json(json_fpath):
    with open(json_fpath, 'r') as fp:
        val_dict = json.load(fp)
    return val_dict

#def get_model(_model_num):
#    _model_num = int(_model_num)
#    _model_num, model_ids = extract_floorplan_ids(_model_num)
#    model_id = model_ids[_model_num]
#    return model_id 
    
if run:
    
    null_fpath = os.path.join(DEEPRAD_MODELS_DIR, '_null.txt')
    with open(null_fpath, 'r') as fp:
        null_lst = fp.readlines()
    model_id_lst = [n.replace('\n', '') for n in null_lst]
    model_id = model_id_lst[_model_num]
    
    # Polygon json
    model_id_dir = os.path.join(
        DEEPRAD_MODELS_DIR, model_id)
    polygon_json_fpath = os.path.join(model_id_dir, 'data', 'polygon.json')

    polygons = load_json(polygon_json_fpath)
    polygons = polygons['polygons']
    
    polys = [to_poly_rh(polygon) for polygon in polygons]
    sim_dir = model_id_dir + '_sim'
    
    ghout_id_dir = os.path.join(DEEPRAD_GHOUT_DIR, model_id)
    ghout_id_dir = os.path.abspath(ghout_id_dir)
# ---------- end python_3 ----------

# ----
# Center geoms
boundary = BoundarySurfaces(Edges=python_3.polys)
bbox = BoundingBox(Content=boundary, Plane=PlaneXY(0, 0, 0), UnionBox=True)  # -> Box, Box_2
area = Area(Geometry=bbox.Box)  # -> Area, Centroid

neg = Negative(Value=area.Centroid)
move = Move(Geometry=python_3.polys, Motion=neg)  # -> Geometry, Transform
boundary_2 = BoundarySurfaces(Edges=graft(move.Geometry))  # -> flatten(Surfaces)
room2d = DFRoom2D(geo=flatten(boundary_2), flr_to_ceiling="2.5", conditioned=Toggle(True))  # -> report, room2d; plug-in component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
panel_7 = Panel(python_3.model_id)
panel_8 = Panel(python_3.sim_dir)
downloadepw = LBDownloadWeather(weather_URL=panel_4)  # -> epw_file, stat_file, ddy_file; plug-in component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
panel_9 = Panel(python.slider_num)
toggle_3 = BooleanToggle(True)
introom2d = DFIntersectRoom2Ds(room2ds=flatten(room2d.room2d), run=toggle_2)  # -> int_room2ds; plug-in component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
solveadj2d = DFSolveAdjacency(room2ds=flatten(introom2d), run=toggle_2)  # -> report, adj_room2ds; plug-in component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
applyfacadepar = DFApplyFacadeParameters(df_obj=flatten(solveadj2d.adj_room2ds), win_par=simpleratiopar)  # -> report, df_obj; plug-in component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
simoutput = HBSimulationOutput(zone_energy_use=toggle_3, gains_and_losses=toggle_3, surface_energy_flow=toggle_3)  # -> report, sim_output; plug-in component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
data = Data(python_3.ghout_id_dir)
camera = CameraCrane(Location=python_2.point, Target="0,0,0", Perspective="0", Refresh=True)  # -> Camera, Target, Lens, Up, HorizontalViewAngle, VerticalViewAngle, ScreenRatio, Frame
list = ValueList({"depth", "construction"}, selected="depth")
toggle_4 = BooleanToggle(True)
toggle_5 = BooleanToggle(True)
list_2 = ValueList({"depth", "construction"}, selected="depth")
story = DFStory(room2ds=flatten(applyfacadepar.df_obj))  # -> report, story; plug-in component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
buildingstories = DFBuildingFromStories(stories=story.story)  # -> report, building; plug-in component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
model = DFModel(buildings=flatten(buildingstories.building), name=panel_7)  # -> report, model; plug-in component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
python_4 = GhPythonScript(ghout_id_dir=data, in_out_dir="out_label", type="solar", view=python_2.orient, run=toggle_4)  # -> img_dir, img_fname, img_fpath
# ---------- python_4: Python ----------
import os 

if run:
    img_dir = \
        os.path.join(_ghout_id_dir, _in_out_dir)
    img_fname = '{}_{}.jpg'.format(_type, _view)
    img_fpath = \
        os.path.join(img_dir, img_fname)
    
    # print img_fpath
# ---------- end python_4 ----------
python_5 = GhPythonScript(ghout_id_dir=data, in_out_dir="in_data", type=list_2, view=python_2.orient, run=toggle_5)  # -> img_dir, img_fname, img_fpath; same code as python_4
analysisperiod = LBAnalysisPeriod(start_month="1", start_day=1, start_hour=0, end_month="1")  # -> period, hoys, dates; plug-in component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
tohoneybee = DFModelToHoneybee(model=model.model, run=Toggle(True))  # -> report, hb_models; plug-in component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
panel_10 = Panel(python_4.img_fpath)
panel_11 = Panel(python_5.img_fpath)
captureview = LBCaptureView(
    file_name=python_4.img_fname,
    folder=python_4.img_dir,
    viewport="deeprad_cam",
    width="800",
    height="100",
    capture=toggle_4)  # -> file; plug-in component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
captureview_2 = LBCaptureView(
    file_name=python_5.img_fname,
    folder=python_5.img_dir,
    viewport="deeprad_cam",
    width="800",
    height="100",
    capture=toggle_5)  # -> file; plug-in component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
panel_12 = Panel("Surface Outside Face Solar Radiation Heat Gain Energy")
data_2 = Data(panel_12)
customoutput = HBCustomSimulationOutput(base_sim_output=simoutput.sim_output, output_names=data_2)  # -> report, sim_output; plug-in component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
panel_13 = Panel(data_2)
simpar = HBSimulationParameter(output=customoutput.sim_output, run_period=analysisperiod.period, timestep=6)  # -> sim_par; plug-in component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
imageviewer = Ladybug_ImageViewer(ImagePath_=panel_11, _scale_=1, DisableClickable=False, SaveImgWithCoords=False, scale=1)  # -> ImagePath, Values, GIF
vizbytype = HBVisualizeByType(hb_objs=tohoneybee.hb_models)  # -> walls, interior_walls, roofs, ceilings, exterior_floors, interior_floors, air_walls, apertures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; plug-in component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
vizbybc = HBVizualizeByBC(hb_objs=tohoneybee.hb_models)  # -> outdoors, surface, ground, adiabatic, other, wire_frame; plug-in component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
vizall = HBVizualizeAll(hb_objs=flatten(tohoneybee.hb_models))  # -> geo; plug-in component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
modeltoosm = HBModelToOSM(model=tohoneybee.hb_models, epw_file=downloadepw.epw_file, sim_par=simpar, folder=panel_8, write=Toggle(False), run="3")  # -> report, jsons, osw, osm, idf, sql, zsz, rdd, html; plug-in component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
panel_14 = Panel("Solar Surface")  # disabled
mjoin = MeshJoin(Meshes=[vizbytype.walls, vizbytype.apertures])
facen = FaceNormals(Mesh=vizbytype.apertures)  # -> Centers, Normals
customresult = HBReadCustomResult(sql=modeltoosm.sql, output_names=panel_12)  # -> results; plug-in component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
readrdd = HBReadResultDictionary(rdd=modeltoosm.rdd, keywords=panel_14)  # -> outputs; disabled; plug-in component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
facen_2 = FaceNormals(Mesh=mjoin)  # -> Centers, Normals
multiplication = Multiplication(A=facen.Normals, B="0.006")
data_3 = Data(python_2.orient)
data_4 = Data(tohoneybee.hb_models)
panel_15 = Panel(modeltoosm.sql)
move_2 = Move(Geometry=vizbytype.apertures, Motion=multiplication)  # -> Geometry, Transform
panel_16 = Panel(readrdd)  # disabled
python_6 = GhPythonScript(depth_vec=facen_2.Centers, orient=data_3)  # -> depth_val; inputs depth_vec: list
# ---------- python_6: Python ----------
import rhinoscriptsyntax as rs

depth_vec = [rs.coerce3dpoint(xx) for xx in depth_vec]

if orient == 'north' or orient == 'south': 
    depth_axis = 1  # y-axis
else:
    depth_axis = 0  # x-axis

depth_val = [xx[depth_axis] for xx in depth_vec]
# ---------- end python_6 ----------
medges = MeshEdges(Mesh=move_2.Geometry)  # -> NakedEdges, InteriorEdges, NonManifoldEdges
colorfaces = HBColorFaces(data=flatten(customresult), hb_objs=flatten(data_4))  # -> report, mesh, wire_frame, legend, title, faces, colors, values; plug-in component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
importepw = LBImportEPW(epw_file=downloadepw.epw_file)  # -> location, dry_bulb_temperature, dew_point_temperature, relative_humidity, wind_speed, wind_direction, direct_normal_rad, diffuse_horizontal_rad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; plug-in component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
preview = CustomPreview(
    Geometry=[vizbytype.wire_frame, medges.NakedEdges, medges.InteriorEdges, medges.NonManifoldEdges],
    Material=ColourSwatch(SwatchColor=RGB(0, 0, 0)))
colrange = LBColorRange(index="22")  # -> colors; plug-in component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
faceenergyattr = HBFaceEnergyAttributes({"Construction": "properties.energy.construction.display_name", "Materials": "properties.energy.construction.layers", "R-Value": "properties.energy.construction.r_value", "U-Value": "properties.energy.construction.u_value", "U-Factor": "properties.energy.construction.u_factor", "Solar Transmitance [Unshaded]": "properties.energy.construction.solar_transmittance", "Solar Reflectance [Outside]": "properties.energy.construction.outside_solar_reflectance", "Solar Reflectance [Inside]": "properties.energy.construction.inside_solar_reflectance", "Fraction Area Operable": "properties.energy.vent_opening.fraction_area_operable", "Fraction Height Operable": "properties.energy.vent_opening.fraction_height_operable", "Discharge Coefficient": "properties.energy.vent_opening.discharge_coefficient", "Cross Ventilation": "properties.energy.vent_opening.wind_cross_vent"}, selected="R-Value")  # disabled
legendpar = LBLegendParameters(min="0", max="1500")  # -> leg_par; plug-in component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
legendpar_2 = LBLegendParameters(min="-10", max="10", colors=colrange)  # -> leg_par; plug-in component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
toggle_6 = BooleanToggle(True)  # disabled
path_2 = FilePath("C:\Users\Administrator\master\git\deeprad\data\models\")  # disabled
skymatrix = LBCumulativeSkyMatrix(location=importepw.location, direct_rad=importepw.direct_normal_rad, diffuse_rad=importepw.diffuse_horizontal_rad)  # -> report, sky_mtx; plug-in component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
python_7 = GhPythonScript(model_id=panel_7, models_dir=path_2, faces=colorfaces.faces, values=colorfaces.values, run=toggle_6)  # -> result; inputs faces: list, values: list; disabled
# ---------- python_7: Python ----------
import os 
import json 

def write_json(val_dict, dest_fpath):
    """Writes hdict to json."""
    with open(dest_fpath, 'w') as fp:
        json.dump(val_dict, fp, indent=4)
        
# Dump face/val as json
DEEPRAD_DATA_DIR = _models_dir 

if run:
    sim_id_dir = \
        os.path.join(DEEPRAD_DATA_DIR, _model_id, 'data_sim')
    label_json_fpath = \
        os.path.join(sim_id_dir, 'label_sim.json')
    
    val_dict = {
        'face_ids': [f.identifier for f in _faces],
        'values': _values
    }
    
    write_json(val_dict, label_json_fpath)
    result = label_json_fpath
# ---------- end python_7 ----------
colorfaceattr = HBColorFaceAttributes(hb_objs=flatten(tohoneybee.hb_models), attribute=faceenergyattr)  # -> mesh, legend, wire_frame, values, colors; disabled; plug-in component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
heatmap = LBSpatialHeatmap(values=python_6, mesh=mjoin, legend_par=legendpar_2)  # -> mesh, legend, title, colors, legend_par; plug-in component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
panel_17 = Panel("22")  # disabled
panel_18 = Panel("6")  # disabled
incidentradiation = LBIncidentRadiation(
    sky_mtx=skymatrix.sky_mtx,
    geometry=flatten(vizall),
    grid_size="1",
    offset_dist="0.005",
    legend_par=legendpar,
    run=Toggle(True))  # -> report, points, results, total, mesh, legend, title, int_mtx; plug-in component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
colrange_2 = LBColorRange(index=panel_18)  # -> colors; disabled; plug-in component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
panel_19 = Panel(python_7)  # disabled
mjoin_2 = MeshJoin(Meshes=colorfaceattr.mesh)  # disabled
panel_20 = Panel("0.31")  # disabled
panel_21 = Panel("2.2")  # disabled
mesh = Mesh(heatmap.mesh)
python_8 = GhPythonScript(x=colorfaceattr.values)  # -> min, max, t; inputs x: list; disabled
# ---------- python_8: Python ----------
_x = sorted(x)
min_, max_ = _x[0], _x[-1]
t = x
# ---------- end python_8 ----------
demesh = DeconstructMesh(Mesh=mjoin_2)  # -> Vertices, Faces, Colours, Normals; disabled
python_9 = GhPythonScript(x=incidentradiation.results)  # -> min, max, t; inputs x: list; same code as python_8
legendpar_3 = LBLegendParameters(min=panel_20, max=panel_21, colors=colrange_2)  # -> leg_par; disabled; plug-in component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
mesh_2 = Mesh(incidentradiation.mesh)
panel_22 = Panel([python_8.min, python_8.max])  # disabled
panel_23 = Panel([python_9.min, python_9.max])
heatmap_2 = LBSpatialHeatmap(values=demesh.Colours, mesh=mjoin_2, legend_par=legendpar_3)  # -> mesh, legend, title, colors, legend_par; disabled; plug-in component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
mesh_3 = Mesh(heatmap_2.mesh)  # disabled
